# Grasshopper definition Mesh_Tiling.gh (Grasshopper 1.0.7)

panel = Panel("Mesh \"Tile\"")
mesh = Mesh()
# Mesh to be Patterned
mesh_2 = Mesh(<mesh referenced from the Rhino model>)

panel_2 = Panel("Attractor Points")
pt = ConstructPoint(XCoordinate=Slider(0, range=0..100), YCoordinate=Slider(100, range=0..100), ZCoordinate=Slider(61, range=0..100))
pt_2 = ConstructPoint(XCoordinate=Slider(0, range=0..100), YCoordinate=Slider(0, range=0..100), ZCoordinate=Slider(0, range=0..100))

facen = FaceNormals(Mesh=mesh_2)  # -> Centers, Normals
cp = ClosestPoint(Point=facen.Centers, Cloud=[pt_2, pt])  # -> ClosestPoint, CPIndex, Distance

# ----
# Convert Mesh to Surface
demesh = DeconstructMesh(Mesh=mesh_2)  # -> Vertices, Faces, Colours, Normals
deface = DeconstructFace(Face=demesh.Faces)  # -> CornerA, CornerB, CornerC, CornerD
item = ListItem(List=demesh.Vertices, Index=deface.CornerA, Wrap=True)
item_2 = ListItem(List=demesh.Vertices, Index=deface.CornerB, Wrap=True)
item_3 = ListItem(List=demesh.Vertices, Index=deface.CornerC, Wrap=True)
item_4 = ListItem(List=demesh.Vertices, Index=deface.CornerD, Wrap=True)
srf4pt = _4PointSurface(CornerA=item, CornerB=item_2, CornerC=item_3, CornerD=item_4)

number_slider = Slider(2, range=0..10)
number_slider_2 = Slider(6, range=0..100)
bnd = Bounds(Numbers=cp.Distance)
pl = PlaneNormal(Origin=facen.Centers, ZAxis=facen.Normals)
remap = RemapNumbers(Value=cp.Distance, Source=bnd, Target=Domain(0, 1))  # -> Mapped, Clipped
graph = GraphMapper(remap.Mapped, x0=0, x1=1, y0=0, y1=1, container_name="Gaussian", factor=0.3826085925, mean=1, sdev=0.08659386635)
ln = Line(StartPoint=cp.ClosestPoint, EndPoint=facen.Centers)
multiplication = Multiplication(A=graph, B=Slider(19, range=0..30))
line = LineSDL(Start=facen.Centers, Direction=facen.Normals, Length=multiplication)
multiplication_2 = Multiplication(A=graph, B=Slider(1, range=0..5))
cyl = Cylinder(Base=PlaneXY(0, 0, 0), Radius=multiplication_2, Length=multiplication)
orient = Orient(Geometry=cyl, Source=PlaneXY(0, 0, 0), Target=pl)  # -> Geometry, Transform
cap = CapHoles(Brep=orient.Geometry)
mjoin = MeshJoin(Meshes=[cap, srf4pt])
